# Grasshopper definition PterodactylTests.gh (Grasshopper 1.0.7)
# plug-ins: Brontosaurus, Pterodactyl

calendar = Calendar()
# Format
# Parts
panel = Panel("Test")
strong = Strong(Text="Test")
emphasis = Emphasis(Text=panel)
strike = Strike(Text="Test")
underline = Underline(Text="Test")
txt = Text("**Test**")
txt_2 = Text("*Test*")
txt_3 = Text("~~Test~~")
txt_4 = Text("<u>Test</u>")
panel_2 = Panel(txt)
panel_3 = Panel(txt_2)
panel_4 = Panel(txt_3)
assert = Assert(TestNames="Strong", Expected=txt, Actual=strong)  # -> Result, FailedInfo
# Format
assert_2 = Assert(TestNames="Emphasis", Expected=txt_2, Actual=emphasis)  # -> Result, FailedInfo
assert_3 = Assert(TestNames="Strike", Expected=txt_3, Actual=strike)  # -> Result, FailedInfo
panel_5 = Panel(txt_4)
assert_4 = Assert(TestNames="Underline", Expected=txt_4, Actual=underline)  # -> Result, FailedInfo
entwine = Entwine(Branch00=assert_2.Result, Branch01=assert_3.Result, Branch02=assert.Result, Branch03=assert_4.Result, FlattenInputs=True)  # -> flatten(Result)
panel_6 = Panel("""Content
Of
First
Heading""")
panel_7 = Panel("""Content
Of
Second
Heading""")
panel_8 = Panel("""Third
Heading
Content
!""")
series = Series(Start=1, Step=1, Count=6)
panel_9 = Panel("""Heading 1
Heading 2
Heading 3""")
horizontal_line = HorizontalLine()
heading = Heading(Text="Test", Level=series)
entwine_2 = Entwine(Branch00=panel_6, Branch01=panel_7, Branch02=panel_8, FlattenInputs=True)
quote = Quote(Text="Test")
page_break = PageBreak()
txt_5 = Text("------")
txt_6 = Text(["# Test", "## Test", "### Test", "#### Test", "##### Test", "###### Test"])
txt_7 = Text("[Test](www.google.com)")
txt_8 = Text("> Test")
txt_9 = Text("<div style=\"page-break-after: always;\"></div>")
panel_10 = Panel("""0
1
2""")
txt_10 = Text(["| Heading 1 | Heading 2 | Heading 3 |", "| --------- | :-------: | --------: |", "| Content   | Content   | Third     |", "| Of        | Of        | Heading   |", "| First     | Second    | Content   |", "| Heading   | Heading   | !         |"])
panel_11 = Panel(txt_5)
panel_12 = Panel(txt_7)
assert_5 = Assert(TestNames="Horizontal Line", Expected=txt_5, Actual=horizontal_line)  # -> Result, FailedInfo
hyperlink = Hyperlink(Text="Test", Link="www.google.com")
panel_13 = Panel(txt_6)
panel_14 = Panel(txt_9)
panel_15 = Panel(txt_8)
assert_6 = Assert(TestNames="Page Break", Expected=txt_9, Actual=page_break)  # -> Result, FailedInfo
assert_7 = Assert(TestNames="Quote", Expected=txt_8, Actual=quote)  # -> Result, FailedInfo
table = Table(TableHeadings=panel_9, Alignment=panel_10, DataTree=entwine_2)
# Parts
assert_list = AssertList(TestName="Heading", ExpectedList=txt_6, ActualList=heading)  # -> Result, FailedInfo
panel_16 = Panel(txt_10)
assert_8 = Assert(TestNames="Hyperlink", Expected=txt_7, Actual=hyperlink)  # -> Result, FailedInfo
assert_list_2 = AssertList(TestName="Table", ExpectedList=txt_10, ActualList=table)  # -> Result, FailedInfo
entwine_3 = Entwine(
    Branch00=assert_list.Result,
    Branch01=assert_5.Result,
    Branch02=assert_8.Result,
    Branch03=assert_6.Result,
    Branch04=assert_7.Result,
    Branch05=assert_list_2.Result,
    FlattenInputs=True)  # -> flatten(Result)
panel_17 = Panel("""First item
Second item""")
panel_18 = Panel("""First task
Second task""")
panel_19 = Panel("""First item
Second item""")
panel_20 = Panel("""False
True""")
unordered_list = UnorderedList(Items=panel_19)
ordered_list = OrderedList(Items=panel_17)
task_list = TaskList(Tasks=panel_18, Done=panel_20)
txt_11 = Text("""1. First item
2. Second item""")
txt_12 = Text("""- [ ] First task
- [x] Second task""")
txt_13 = Text("""- First item
- Second item""")
panel_21 = Panel(txt_11)
panel_22 = Panel(txt_12)
panel_23 = Panel(txt_13)
assert_list_3 = AssertList(TestName="Ordered list", ExpectedList=txt_11, ActualList=ordered_list)  # -> Result, FailedInfo
assert_list_4 = AssertList(TestName="Unordered list", ExpectedList=txt_13, ActualList=unordered_list)  # -> Result, FailedInfo
assert_list_5 = AssertList(TestName="Task list", ExpectedList=txt_12, ActualList=task_list)  # -> Result, FailedInfo
entwine_4 = Entwine(Branch00=assert_list_3.Result, Branch01=assert_list_5.Result, Branch02=assert_list_4.Result, FlattenInputs=True)  # -> flatten(Result)
code_block = CodeBlock(ProgrammingLanguage="Python", Code="print(\"Hello world\")")
dynamic_math_block = DynamicMathBlock(Text="2 \cdot sin(x) + cos(y) = 2 \cdot sin(<x>) + cos(<y>) = ...", VariablesSymbols=["x", "y"], VariablesValues=[1, 2])
txt_14 = Text("""```Python
print("Hello world")
```""")
panel_24 = Panel(txt_14)
assert_list_6 = AssertList(TestName="Code block", ExpectedList=txt_14, ActualList=code_block)  # -> Result, FailedInfo
entwine_5 = Entwine(Branch00=assert_list_6.Result, FlattenInputs=True)  # -> flatten(Result)
total = Total(Results=[entwine, entwine_3, entwine_4, entwine_5])  # -> TotalResult, ReportPart
panel_25 = Panel(total.TotalResult)
